# Grasshopper definition clickable_preview.gh (Grasshopper 0.9.76)
# plug-ins: GHAddons

mbox = MeshBox(Base={Plane=PlaneXY(0, 0, 0), X=Domain(-10, 10), Y=Domain(-10, 10), Z=Domain(-10, 10)}, XCount=1, YCount=10, ZCount=10)
arrrec = RectangularArray(
    Geometry=mbox,
    Cell={Plane=PlaneXY(-23.2447048, -16.15196088, 0), Size=Domain2(u=0..61.64162489, v=0..45.47332984)},
    XCount=3,
    YCount=3)  # -> Geometry, Transform
clickablepreview = ClickablePreview(Enable=Toggle(True), Meshes=arrrec.Geometry)  # -> SelectedMeshes, SelectedIndices
panel = Panel(clickablepreview.SelectedIndices)
panel_2 = Panel(clickablepreview.SelectedMeshes)
