# Grasshopper definition storage.gh (Grasshopper 0.9.76)
# plug-ins: GHAddons, PathTool

pathtool = PathTool(RelPath="my.db")
gatebutton = GateButton(Button=Button())
storage = Storage(Button=gatebutton, DbPath=pathtool)
